# Grasshopper definition window_in_wall.ghx (Grasshopper 1.0.7)

reload = Button()
py = PythonScript(reload=reload)
# ---------- py: Python ----------
from compas_rhino.utilities.misc import get_tolerance
from compas_rhino.utilities.misc import unload_modules

from compas_ghpython import unload_modules

unload_modules("compas")
unload_modules("compas_fab")
unload_modules("ur_fabrication_control")
unload_modules("assembly_information_model")
unload_modules("am_information_model") 
unload_modules("window_in_wall")
# ---------- end py ----------
py_2 = PythonScript()  # -> HERE, DATA
# ---------- py_2: Python ----------
import os

HERE = os.path.dirname(ghdoc.Path)
DATA = os.path.abspath(os.path.join(HERE, "..", "data"))

#print(HERE)
#print(DATA)
# ---------- end py_2 ----------

gate_size = Number(0.84)
gate_x = Number(1.74)

height = Number(3.3)
elsize = Number(0.053)
width = Number(3.5)
create_wall = GhPythonScript(init=Button(), width=width, height=height, elsize=elsize)  # -> wall
# ---------- create_wall: Python ----------
from window_in_wall import Wall


# create wall
wall = Wall()


# construct COMPAS quad mesh from width and height
wall.create_quad_mesh_from_dimensions(width, height, elsize)
# ---------- end create_wall ----------

list = ValueList({"circular", "persian"}, selected="persian")
toggle = BooleanToggle(True)
make_gate = GhPythonScript(wall=create_wall, make_gate=toggle, gate_type=list, gate_x=gate_x, gate_size=gate_size)  # -> out, wall
# ---------- make_gate: Python ----------
if make_gate:
    wall.make_gate(gate_size, gate_x, gate_type)
# ---------- end make_gate ----------
displacement = GhPythonScript(wall=make_gate.wall, comp_displ=toggle)  # -> out, wall
# ---------- displacement: Python ----------
from compas.rpc import Proxy

if comp_displ:
    #wall_methods_numpy = Proxy('window_in_wall.wall_methods_numpy')
    wall_methods_pde = Proxy('window_in_wall.wall_methods_pde')
    #wall_methods_numpy.stop_server() #if changes need to be reloaded
    #wall_methods_numpy.start_server()
    
    # compute displacement
    #solX, solZ = wall_methods_numpy.compute_displacement(wall.mesh,wall.gate_points, wall.x_size, wall.z_size)
    solX = wall_methods_pde.compute_displacement_x(wall.mesh,wall.gate_points, wall.x_size, wall.z_size)
    
    # update vertex attributes with displacement values
    for v, data in wall.mesh.vertices(data=True):        
        wall.mesh.vertex_attribute(v, "x_disp", value=solX[v]) #value=solX[n_from_ij(i,j, wall.z_size)]
        #wall.mesh.vertex_attribute(v, "z_disp", value=solZ[v]) #value=solZ[n_from_ij(i,j, wall.z_size)]
    
    # displace the vertices (for preview only)
    # wall.displace_vertices()
    #solmat = np.reshape(solX, (-1, n))
# ---------- end displacement ----------

up_phase = Slider(0.912, range=0..3)
up_freq = Slider(1.97, range=1..3)
up_amp = Slider(0.075, range=0..0.1)
down_phase = Slider(1.023, range=0..3)
down_freq = Slider(2.107, range=1..3)
down_amp = Slider(0.028, range=0..0.1)
wave = GhPythonScript(
    wall=displacement.wall,
    wave=Toggle(True),
    up_amp=up_amp,
    up_freq=up_freq,
    up_phase=up_phase,
    down_amp=down_amp,
    down_freq=down_freq,
    down_phase=down_phase)  # -> out, wall; inputs wave: Boolean
# ---------- wave: Python ----------
if wave:
    #wall.undulate(amp, freq, phase)
    #wall.undulate(up_amp, up_freq, up_phase, down_amp, down_freq, down_phase)
    wall.undulate_with_displ(up_amp, up_freq, up_phase, down_amp, down_freq, down_phase)
    #wall.undulate_with_displ(amp, freq, phase)
# ---------- end wave ----------

visualize = GhPythonScript(wall=wave.wall)  # -> out, rhmesh, vertices
# ---------- visualize: Python ----------
from compas_ghpython.artists import MeshArtist

# Mesh Artist for visualization
artist = MeshArtist(wall.mesh)
#vertices = artist.draw_vertices()
#edges = artist.draw_edges()
#faces = artist.draw_faces()
#labels = {key: key for key in mesh.vertices()}

rhmesh = artist.draw()


# draw gate points
v = []
for vertex in wall.mesh.vertices():
    gp = wall.mesh.vertex_attribute(vertex, name='in_gate')
    if gp: v.append(vertex)

if len(v): vertices = artist.draw_vertices(vertices=v)
# ---------- end visualize ----------
pt = Point(visualize.vertices)
mesh = Mesh(visualize.rhmesh)
preview = CustomPreview(Geometry=mesh, Material=ColourSwatch(SwatchColor=RGB(255, 125, 125)))
preview_2 = CustomPreview(Geometry=pt, Material=ColourSwatch(SwatchColor=RGB(255, 184, 184)))
